# Grasshopper definition unnamed2d.gh (Grasshopper 1.0.7)

geo = Geometry(<brep referenced from the Rhino model>)
geo_2 = Geometry(<brep referenced from the Rhino model>)
series = Series(Start=0, Step=Slider(50.4, range=0..100), Count=Slider(14, range=0..100))
series_2 = Series(Start=0, Step=Slider(72, range=0..100), Count=Slider(10, range=0..10))
Z = UnitZ(Factor=series)
Z_2 = UnitZ(Factor=series_2)
Y = UnitY(Factor=series)
Y_2 = UnitY(Factor=series_2)
X = UnitX(Factor=series)
X_2 = UnitX(Factor=series_2)
multiplication = Multiplication(A=X_2, B=Slider(6, range=0..10))
multiplication_2 = Multiplication(A=X, B=Slider(10, range=0..10))
move = Move(Geometry=geo, Motion=multiplication_2)  # -> Geometry, Transform
move_2 = Move(Geometry=geo_2, Motion=multiplication)  # -> Geometry, Transform
multiplication_3 = Multiplication(A=Y, B=Slider(7, range=0..10))
multiplication_4 = Multiplication(A=Y_2, B=Slider(6, range=0..10))
multiplication_5 = Multiplication(A=Z, B=Slider(6, range=0..10))
multiplication_6 = Multiplication(A=Z_2, B=Slider(6, range=0..10))
crossref = CrossReference(ListA=move.Geometry, ListB=multiplication_3, CrossMode=1)  # -> ListA, ListB
crossref_2 = CrossReference(ListA=move_2.Geometry, ListB=multiplication_4, CrossMode=1)  # -> ListA, ListB
move_3 = Move(Geometry=crossref.ListA, Motion=crossref.ListB)  # -> Geometry, Transform
move_4 = Move(Geometry=crossref_2.ListA, Motion=crossref_2.ListB)  # -> Geometry, Transform
crossref_3 = CrossReference(ListA=move_3.Geometry, ListB=multiplication_5, CrossMode=1)  # -> ListA, ListB
crossref_4 = CrossReference(ListA=move_4.Geometry, ListB=multiplication_6, CrossMode=1)  # -> ListA, ListB
move_5 = Move(Geometry=crossref_3.ListA, Motion=crossref_3.ListB)  # -> Geometry, Transform
move_6 = Move(Geometry=crossref_4.ListA, Motion=crossref_4.ListB)  # -> Geometry, Transform
reduce = RandomReduce(List=move_5.Geometry, Reduction=Slider(2700, range=0..10000), Seed=Slider(7, range=0..10))
reduce_2 = RandomReduce(List=move_6.Geometry, Reduction=Slider(911, range=0..1000), Seed=Slider(6, range=0..10))
merge = Merge(Data1=reduce_2, Data2=reduce)
